# Grasshopper definition GenerateBlockKeyTypologies.gh (Grasshopper 1.0.7)

panel = Panel("""tower block var. 1
tower block var. 2
double expose tower block
large tower block var. 1
large tower block var. 2
single loaded slab block
double loaded slab block
L slab block""")
footprint_collection = Curve([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])
item = ListItem(List=footprint_collection, Index=Slider(1, range=0..14), Wrap=True)
python = GhPythonScript(Crvs=footprint_collection, Names=panel)  # -> out, a; inputs Crvs: list of Curve, Names: list
# ---------- python: Python ----------
__author__ = "jingz"
__version__ = "2025.04.08"

import rhinoscriptsyntax as rs

import ghpythonlib.components as gh

import json

data = {}

for name,crv in zip(Names,Crvs):
    
    coords = [[[pt.X,pt.Y,pt.Z] for pt in gh.ControlPoints(crv).points]]
    
    data[name] = {'geometry':{'coordinates':coords,'type':'Polygon'},'properties':{}}

with open('C:\Users\jingz\OneDrive\Desktop\output.json', 'w') as f:
    json.dump(data, f, indent=4)
# ---------- end python ----------
